# Grasshopper definition circle stacking 1.gh (Grasshopper 1.0.4)

dropout_number = Slider(18, range=0..40)
rib_count = Slider(28, range=0..40)
rib_seed = Slider(7, range=0..20)
crv = Curve(<curve referenced from the Rhino model>)
random = Random(Range=Domain(0, 100), Number=dropout_number, Seed=Slider(8, range=0..20))
random_2 = Random(Range=Domain(1, 3), Number=rib_count, Seed=rib_seed)
smaller = SmallerThan(FirstNumber=random, SecondNumber=Slider(21, range=0..100))  # -> SmallerThan, OrEqualTo
int = Integer(random_2)

series = Series(Start=0, Step=1, Count=rib_count)
rev = ReverseList(List=series)
shift = ShiftList(List=int, Shift=graft(rev), Wrap=False)
panel = Panel("Cn = SUM[0->n](2*Ri) + Rn")
ma = MassAddition(Input=shift)  # -> Result, PartialResults
multiplication = Multiplication(A=2, B=ma.Result)
flatten = FlattenTree(Tree=multiplication, Path="{0}")
ins = InsertItems(List=flatten, Item=0, Indices=0, Wrap=True)

rev_2 = ReverseList(List=int)
addition = Addition(A=rev_2, B=ins)
panel_2 = Panel(rev_2)
panel_3 = Panel(ins)
multiplication_2 = Multiplication(A=0.125, B=addition)
circle_centers = ConstructPoint(XCoordinate=multiplication_2, YCoordinate=0, ZCoordinate=0)
eval = Evaluate()
sift = SiftPattern(List=rev_2, SiftPattern=smaller.OrEqualTo)  # -> Output0, Output1
panel_4 = Panel(sift.Output0)
sift_2 = SiftPattern(List=circle_centers, SiftPattern=sift.Output0)  # -> Output0, Output1, Output2, Output3
pt = Point(sift_2.Output1)
pt_2 = Point(sift_2.Output3)
pt_3 = Point(sift_2.Output0)
pt_4 = Point(sift_2.Output2)
nullrep = ReplaceNulls(Items=sift.Output0, Replacements=0)  # -> Items, Count
xz = XZPlane(Origin=Point(0, 0, 0))
eval_2 = EvaluateLength(Curve=crv, Length=multiplication_2, Normalized=False)  # -> Point, Tangent, Parameter
multiplication_3 = Multiplication(A=0.125, B=nullrep.Items)
panel_5 = Panel(multiplication_3)
circle = CircleCNR(Center=eval_2.Point, Normal=xz, Radius=multiplication_3)
material = CreateMaterial(Diffuse=RGB(184, 255, 248), Specular=RGB(255, 255, 255), Emission=RGB(0, 0, 0), Transparency=0, Shine=0)
revsrf = Revolution(Curve=crv, Axis=Line((0, 0, 0), (0, 0, 6.75)), Domain=Domain(0, 6.283185307))
revsrf_2 = Revolution(Curve=circle, Axis=Line((0, 0, 0), (0, 0, 6.75)), Domain=Domain(0, 6.283185307))
cap = CapHoles(Brep=revsrf)
preview = CustomPreview(Geometry=[cap, revsrf_2], Material=material)
