# Grasshopper definition 2. Roughing.gh (Grasshopper 1.0.4)
# plug-ins: EleFront

panel = Panel("Roughing Pass 1")
bake_now = Button()
horizontal_spacing = Slider(0.1, range=0..0.5)
vertical_spacing = Slider(0.33, range=0..0.55)
pipeline = GeometryPipeline(
    GroupByLayer=False,
    GroupByType=False,
    IncludeHidden=True,
    IncludeLocked=True,
    LayerFilter="Mold::Roughing Volume",
    NameFilter="*",
    SublayerFiltering=True,
    TypeFilter=1073741848)
docstr = CSharpScript(Key="PassingHeight")  # -> out, A; inputs Key: String
# ---------- docstr: C# ----------
    doc = Rhino.RhinoDoc.ActiveDoc;
    for (int i = 0; i < doc.Strings.Count; i++)
    {
      if (String.Equals(doc.Strings.GetKey(i), Key as string, StringComparison.OrdinalIgnoreCase))
        A = doc.Strings.GetValue(i);
    }
# ---------- end docstr ----------
docstr_2 = CSharpScript(Key="Bit Diameter")  # -> out, A; inputs Key: String; same code as docstr
panel_2 = Panel(docstr.A)
panel_3 = Panel(docstr_2.A)
getua = GetUserAttributes(Geometry=pipeline)  # -> Keys, Values, BakeName
division = Division(A=panel_3, B=2)
brep = Brep(graft(pipeline))
panel_4 = Panel(getua.Keys)

# ---- group: Horizontal Slices
bbox = BoundingBox(Content=brep, Plane=PlaneXY(0, 0, 0))  # -> Box, Box_2
box_corners = BoxCorners(Box=bbox.Box)  # -> CornerA, CornerB, CornerC, CornerD, CornerE, CornerF, CornerG, CornerH
pl_3pt = Plane3Pt(PointA=box_corners.CornerA, PointB=box_corners.CornerB, PointC=box_corners.CornerC)
ln = Line(StartPoint=box_corners.CornerA, EndPoint=box_corners.CornerE)
len = Length(Curve=ln)
division_2 = Division(A=len, B=vertical_spacing)
planesrf = PlaneSurface(Plane=pl_3pt, XSize=Domain(-10, 10), YSize=Domain(-10, 10))

# ----
addition = Addition(A=division_2, B=1)

# ---- group: Horizontal Slices (continued)
divide = DivideCurve(Curve=ln, Count=addition, Kinks=False)  # -> Points, Tangents, Parameters
vec2pt = Vector2Pt(PointA=divide.Points, PointB=box_corners.CornerE, Unitize=False)  # -> Vector, Length
move = Move(Geometry=planesrf, Motion=vec2pt.Vector)  # -> Geometry, Transform
bbx = BrepBrep(BrepA=move.Geometry, BrepB=brep)  # -> Curves, Points
boundary = BoundarySurfaces(Edges=bbx.Curves)

# ---- group: Vertical Slices
bbox_2 = BoundingBox(Content=boundary, Plane=PlaneXY(0, 0, 0))  # -> Box, Box_2
box_corners_2 = BoxCorners(Box=bbox_2.Box)  # -> CornerA, CornerB, CornerC, CornerD, CornerE, CornerF, CornerG, CornerH
ln_2 = Line(StartPoint=box_corners_2.CornerA, EndPoint=box_corners_2.CornerB)
len_2 = Length(Curve=ln_2)
division_3 = Division(A=len_2, B=horizontal_spacing)
addition_2 = Addition(A=division_3, B=1)
divide_2 = DivideCurve(Curve=ln_2, Count=addition_2, Kinks=False)  # -> Points, Tangents, Parameters
yz = YZPlane(Origin=divide_2.Points)
planesrf_2 = PlaneSurface(Plane=yz, XSize=Domain(-20, 20), YSize=Domain(-10, 10))

# ----
bbx_2 = BrepBrep(BrepA=graft(boundary), BrepB=planesrf_2)  # -> Curves, Points
simplify = SimplifyTree(Tree=bbx_2.Curves, Front=False)
trim = TrimTree(Tree=simplify, Depth=1)
branch = TreeBranch(Tree=trim, Path="{0;4}", MaintainPaths=True)
item = ListItem(List=branch, Index=Slider(1, range=0..31), Wrap=False)
c_script = CSharpScript(BakeNow=bake_now, Geometry=trim, Layer="Roughing::Pass 1", CacheName="Toolpaths")  # -> out, A; inputs BakeNow: Boolean, Geometry: tree, Layer: String, CacheName: String
# ---------- c_script: C# ----------
    if (!BakeNow)
      return;
    
    var doc = Rhino.RhinoDoc.ActiveDoc;
    var result = new System.Text.StringBuilder();
    var layerIndex = doc.Layers.FindByFullPath(Layer, 0);
    var key = string.Format("Cache({0})", CacheName);

    // Delete existing cache data
    var existing = doc.Objects.FindByUserString(key, "*", false);
    foreach(RhinoObject obj in existing)
    {
      if (obj.Attributes.LayerIndex == layerIndex)
      {
        doc.Objects.Delete(obj, true);
      }
    }



    // Save geometry to model
    for (int i = 0; i < Geometry.Branches.Count; i++)
    {
      var path = Geometry.Paths[i];
      for (int g = 0; g < Geometry.Branches[i].Count; g++)
      {
        var geo = Geometry.Branches[i][g];
        var attr = new Rhino.DocObjects.ObjectAttributes();
        var cacheValue = string.Format("{0}({1})", path, g);
        attr.SetUserString(key, cacheValue);
        attr.LayerIndex = layerIndex;
        result.Append(cacheValue).Append("\r\n");
        result.Append(geo.GetType()).Append("\r\n");
        doc.Objects.Add((Rhino.Geometry.GeometryBase) geo, attr);
      }
    }
    A = result;
# ---------- end c_script ----------
panel_5 = Panel(trim)
