# Grasshopper definition 3. Roughing.gh (Grasshopper 1.0.4)
# plug-ins: EleFront

panel = Panel("Roughing Pass 2")
bake_now = Button()
docstr = CSharpScript(Key="PassingHeight")  # -> out, A; inputs Key: String
# ---------- docstr: C# ----------
    doc = Rhino.RhinoDoc.ActiveDoc;
    for (int i = 0; i < doc.Strings.Count; i++)
    {
      if (String.Equals(doc.Strings.GetKey(i), Key as string, StringComparison.OrdinalIgnoreCase))
        A = doc.Strings.GetValue(i);
    }
# ---------- end docstr ----------
docstr_2 = CSharpScript(Key="Bit Diameter")  # -> out, A; inputs Key: String; same code as docstr
pipeline = GeometryPipeline(
    GroupByLayer=False,
    GroupByType=False,
    IncludeHidden=True,
    IncludeLocked=True,
    LayerFilter="Mold::Roughing Surfaces",
    NameFilter="*",
    SublayerFiltering=True,
    TypeFilter=1073741848)
panel_2 = Panel(docstr.A)
panel_3 = Panel(docstr_2.A)
division = Division(A=panel_3, B=2)
brep = Brep(graft(pipeline))
xz = XZPlane(Origin=Point(0, 0, 0))
Y = UnitY(Factor=1)
contour = Contour(Shape=brep, Point=xz, Direction=Y, Distance=division)
simplify = SimplifyTree(Tree=contour, Front=False)
trim = TrimTree(Tree=simplify, Depth=2)
sift = SiftPattern(List=trim, SiftPattern=[0, 1])  # -> Output0, Output1

# ---- group: Connect Left Ends of Curves
flip = FlipCurve(Curve=sift.Output0)  # -> Curve, Flag
end = EndPoints(Curve=flip.Curve)  # -> Start, End
shift = ShiftList(List=end.End, Shift=-1, Wrap=False)
clean = CleanTree(RemoveNulls=True, RemoveInvalid=True, RemoveEmpty=False, Tree=shift)

# ---- group: Connect Right Ends of Curves
end_2 = EndPoints(Curve=sift.Output1)  # -> Start, End
shift_2 = ShiftList(List=end.Start, Shift=1, Wrap=False)
shift_3 = ShiftList(List=end_2.End, Shift=1, Wrap=False)
clean_2 = CleanTree(RemoveNulls=True, RemoveInvalid=True, RemoveEmpty=False, Tree=shift_2)
clean_3 = CleanTree(RemoveNulls=True, RemoveInvalid=True, RemoveEmpty=False, Tree=shift_3)
short = ShortestList(ListA=clean_2, ListB=clean_3, TrimMode=2)  # -> ListA, ListB
ln = Line(StartPoint=short.ListA, EndPoint=short.ListB)
shift_4 = ShiftList(List=ln, Shift=1, Wrap=False)

# ---- group: Connect Left Ends of Curves (continued)
clean_4 = CleanTree(RemoveNulls=True, RemoveInvalid=True, RemoveEmpty=False, Tree=end_2.Start)
ln_2 = Line(StartPoint=clean, EndPoint=clean_4)

# ----
weave = Weave(Pattern=[0, 1, 2, 3], Stream0=flip.Curve, Stream1=ln_2, Stream2=sift.Output1, Stream3=shift_4, NullGaps=False)
join = JoinCurves(Curves=weave, Preserve=False)

# ---- group: Move -Z to Tip Of Bit
Z = UnitZ(Factor=1)
multiplication = Multiplication(A=division, B=Z)
neg = Negative(Value=multiplication)
move = Move(Geometry=join, Motion=neg)  # -> Geometry, Transform

# ----
end_3 = EndPoints(Curve=move.Geometry)  # -> Start, End

# ---- group: Entry Path
pdecon = Deconstruct(Point=end_3.Start)  # -> XComponent, YComponent, ZComponent
pt = ConstructPoint(XCoordinate=pdecon.XComponent, YCoordinate=pdecon.YComponent, ZCoordinate=panel_2)

# ---- group: Exit Path
pdecon_2 = Deconstruct(Point=end_3.End)  # -> XComponent, YComponent, ZComponent
pt_2 = ConstructPoint(XCoordinate=pdecon_2.XComponent, YCoordinate=pdecon_2.YComponent, ZCoordinate=panel_2)

# ----
ln_3 = Line(StartPoint=end_3.End, EndPoint=pt_2)
ln_4 = Line(StartPoint=pt, EndPoint=end_3.Start)
weave_2 = Weave(Pattern=[0, 1, 2], Stream0=ln_4, Stream1=move.Geometry, Stream2=ln_3, NullGaps=False)
join_2 = JoinCurves(Curves=weave_2, Preserve=False)

# ---- group: Bake
layer = DefineLayer(Name="Roughing::Pass 2")
attributes = DefineObjectAttributes(Layer=layer)
bake = BakeObjects(Geometry=join_2, Attributes=attributes, BakeName=layer, Bake=bake_now)
