# Grasshopper definition 7. Pocketing.gh (Grasshopper 1.0.4)

bake_now = Button()
input_curves = Curve([<curve referenced from the Rhino model> x2])
cache_name = Panel("Pocketing")
layer_name = Panel("Pocket Toolpaths")
depth_of_pocket = Slider(0.5, range=0..2)
depth_of_pass = Slider(0.25, range=0..2)
rib_thickness = Panel(".25")
tool_diameter = Panel(".25")
contour_offset = Panel(".5")
division = Division(A=rib_thickness, B=-2)
offset = Offset(Curve=input_curves, Distance=division, Plane=PlaneXY(0, 0, 0), Corners=1)

# ---- group: Vertical slices
division_2 = Division(A=depth_of_pocket, B=depth_of_pass)
range = Range(Domain=depth_of_pocket, Steps=division_2)
shift = ShiftList(List=range, Shift=1, Wrap=False)
neg = Negative(Value=shift)
vec = VectorXYZ(XComponent=0, YComponent=0, ZComponent=neg)  # -> Vector, Length

# ----
inputs = Curve(flatten(offset))

# ---- group: Pocket Finishing
division_3 = Division(A=tool_diameter, B=-2)
offset_2 = Offset(Curve=inputs, Distance=division_3, Plane=PlaneXY(0, 0, 0), Corners=1)
simplify = SimplifyTree(Tree=offset_2, Front=False)
move = Move(Geometry=graft(simplify), Motion=vec.Vector)  # -> Geometry, Transform
path_mapper = PathMapper(move.Geometry, source="{A;B;C}", target="{C;100}")

# ---- group: Pocket roughing
move_2 = Move(Geometry=graft(inputs), Motion=vec.Vector)  # -> Geometry, Transform
division_4 = Division(A=tool_diameter, B=-1.8)
offset_3 = Offset(Curve=move_2.Geometry, Distance=division_4, Plane=PlaneXY(0, 0, 0), Corners=1)
division_5 = Division(A=division_3, B=2)
simplify_2 = SimplifyTree(Tree=offset_3, Front=False)
contour = Contour(Curve=simplify_2, Point=Point(0, 0, 0), Direction=Vector(0.25, 0, 0), Distance=contour_offset)  # -> Contours, Parameters
cullpt = CullDuplicates(Points=contour.Contours, Tolerance=0.1, CullMode=3)  # -> Points, Indices, Valence
sort_pt = SortPoints(Points=cullpt.Points)  # -> Points, Indices
dispatch = Dispatch(List=sort_pt.Points, DispatchPattern=[True, False])  # -> ListA, ListB
pt = Point(dispatch.ListA)
pt_2 = Point(dispatch.ListB)
ln = Line(StartPoint=pt, EndPoint=pt_2)
trim = TrimTree(Tree=ln, Depth=2)

# ----
crv = Curve([path_mapper, trim])
panel = Panel(crv)
c_script = CSharpScript(BakeNow=bake_now, Geometry=crv, Layer=layer_name, CacheName=cache_name)  # -> out, A; inputs BakeNow: Boolean, Geometry: tree, Layer: String, CacheName: String
# ---------- c_script: C# ----------
    if (!BakeNow)
      return;

    var doc = Rhino.RhinoDoc.ActiveDoc;
    var result = new System.Text.StringBuilder();
    int layerIndex = 0;
    if (Layer == null)
      layerIndex = doc.Layers.CurrentLayerIndex;
    else
      layerIndex = doc.Layers.FindByFullPath(Layer, 0);
    var key = string.Format("Cache({0})", CacheName);

    // Delete existing cache data
    var existing = doc.Objects.FindByUserString(key, "*", false);
    foreach(RhinoObject obj in existing)
    {
      if (obj.Attributes.LayerIndex == layerIndex)
      {
        doc.Objects.Delete(obj, true);
      }
    }



    // Save geometry to model
    for (int i = 0; i < Geometry.Branches.Count; i++)
    {
      var path = Geometry.Paths[i];
      for (int g = 0; g < Geometry.Branches[i].Count; g++)
      {
        var geo = Geometry.Branches[i][g];
        var attr = new Rhino.DocObjects.ObjectAttributes();
        var cacheValue = string.Format("{0}({1})", path, g);
        attr.SetUserString(key, cacheValue);
        attr.LayerIndex = layerIndex;
        result.Append(cacheValue).Append("\r\n");
        result.Append(geo.GetType()).Append("\r\n");
        if (geo is Rhino.Geometry.Line)
          doc.Objects.AddLine((Rhino.Geometry.Line) geo, attr);
        else
          doc.Objects.Add((Rhino.Geometry.GeometryBase) geo, attr);
      }
    }
    A = result;
# ---------- end c_script ----------
c_script_2 = CSharpScript(BakeNow=Button(), CacheName="Toolpaths")  # -> out, A; inputs BakeNow: Boolean, Geometry: tree, Layer: String, CacheName: String; same code as c_script
