# Grasshopper definition 9. Machine.gh (Grasshopper 1.0.4)
# plug-ins: EleFront

# Instructions: Inputs:
#   Bit Diameter (Document User String)
#   PassingHeight (Document User String)
#   Toolpaths (Curves with Object User Strings)
# 
# Configuration:
#   Spindle speed (this drives
# 
# Input curves can be on any layer.
# All input geometry has a UserString key of
# 
#   Cache(Toolpaths)
# 
# The value of the UserString is a path and list index so that a collection of curves can be reconstituted into a tree with one layer:
# 
# {0}
#  crv1
#  crv2
#  crv3
# {1}
#  crv1
#  crv2
# {2}
#  crv1
# {3}
#  crv1
#  crv2
#  crv3
#  crv4
# ...
# 
# Each branch represents a cutting operation with one or more toolpaths. This definition creates a vertical entry path to the start of the first curve, and a vertical exit path from the end of the last curve. Odd numbered paths will be reversed so that the tool can descend one layer and trace back through the previous cut.
manual_selected_input_curves = Curve(graft([<curve referenced from the Rhino model> x75]))
roughing_1 = GeometryCache(MaintainReferences=False)
roughing_2 = GeometryCache(MaintainReferences=False)
finishing_1_4 = GeometryCache(MaintainReferences=False)
finishing_3_8 = GeometryCache(MaintainReferences=False)
finishing_1_2 = GeometryCache(MaintainReferences=False)
pocketing = GeometryCache(MaintainReferences=False)
panel = Panel("Machining Pass")
save_now = Button()
x_offset = Slider(0, range=0..8)
y_offset = Slider(0, range=0..6)
spindle_speed = Slider(5, range=1..6)
cut = Button()
pause = Button()
resume = Button()
quit = Button()
path_mapper = PathMapper(manual_selected_input_curves, source="{A;B}", target="{B;0}")
activedoc = CSharpScript()  # -> out, Folder, Name
# ---------- activedoc: C# ----------
    Folder = System.IO.Path.GetDirectoryName(RhinoDoc.ActiveDoc.Path);
    Name = System.IO.Path.GetFileNameWithoutExtension(RhinoDoc.ActiveDoc.Name);
# ---------- end activedoc ----------
crv = Curve(manual_selected_input_curves)
vec = VectorXYZ(XComponent="0", YComponent="0", ZComponent=0)  # -> Vector, Length
docstr = CSharpScript(Key="PassingHeight")  # -> out, A; inputs Key: String
# ---------- docstr: C# ----------
    doc = Rhino.RhinoDoc.ActiveDoc;
    for (int i = 0; i < doc.Strings.Count; i++)
    {
      if (String.Equals(doc.Strings.GetKey(i), Key as string, StringComparison.OrdinalIgnoreCase))
        A = doc.Strings.GetValue(i);
    }
# ---------- end docstr ----------
docstr_2 = CSharpScript(Key="Bit Diameter")  # -> out, A; inputs Key: String; same code as docstr
item = ListItem(List=flatten(crv), Index=0, Wrap=True)
panel_2 = Panel(docstr_2.A)
panel_3 = Panel(docstr.A)
chip_load = Panel(".01")
crv_2 = Curve(item)
panel_4 = Panel(path_mapper)
remap = RemapNumbers(Value=spindle_speed, Source=Domain(1, 6), Target=Domain(16000, 27000))  # -> Mapped, Clipped
tool = CSharpScript(cl=chip_load, dia=0.25, fl=2, sp=remap.Mapped)  # -> out, RPM, FR
# ---------- tool: C# ----------
// ChipLoad x CutterDiameter x NumberOfFlutes x SpindleSpeed = FeedRate
// ChipLoad = amout of material cut per tooth
// FeedRate = surface speed of tool in inches per minute
// SpindleSpeed = rotational speed of tool, RPM

var _fr  = Convert.ToDouble(fr);
var _sp  = Convert.ToDouble(sp);
var _cl  = Convert.ToDouble(cl);
var _dia = Convert.ToDouble(dia);
var _fl  = Convert.ToDouble(fl);


if (_fr == 0.0 && _sp == 0.0) {
  RPM = 0;
  FR = 0;
}
else if (_fr == 0.0)
{
  // Solve for Feed Rate
  FR = (_cl * _dia * _fl * _sp) / 60;
  RPM = _sp;
}
else if (_sp == 0.0)
{
  // Solve for Spindle Speed
  RPM = _fr / (_cl * _dia * _fl);
  FR = _fr;
}
else
{
  // print("Warning: cannot specify both feed rate and spindle speed");
  FR = 0;
  RPM = 0;
}
# ---------- end tool ----------
remap_2 = RemapNumbers(Value=tool.RPM, Source=Domain(16000, 27000), Target=Domain(1, 6))  # -> Mapped, Clipped
feed_rate = Panel(tool.FR)
spindle_speed_2 = Panel(remap_2.Mapped)
passing_height = Number(panel_3)
vec_2 = VectorXYZ(XComponent="0", YComponent="0", ZComponent=0)  # -> Vector, Length
division = Division(A=tool.FR, B=4)

# ---- group: Trim curves to machine volume
# This section produces data in the form
# 
# {
#   Object,
#   Layer,
#   Sub-Layer
# }
# (Move)
brep = Brep(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)
crv_3 = Curve(crv)
bbox = BoundingBox(Content=brep, Plane=PlaneXY(0, 0, 0))  # -> Box, Box_2
debox = DeconstructBox(Box=bbox.Box)  # -> Plane, X, Y, Z
dedomain = DeconstructDomain(Domain=debox.Y)  # -> Start, End
dedomain_2 = DeconstructDomain(Domain=debox.X)  # -> Start, End
multiplication = Multiplication(A=dedomain.End, B=y_offset)
X = UnitX(Factor=1)
Y = UnitY(Factor=1)
multiplication_2 = Multiplication(A=multiplication, B=Y)

# ----
subtraction = Subtraction(A=dedomain_2.End, B=dedomain_2.Start)
panel_5 = Panel(crv_3)

# ---- group: Trim curves to machine volume (continued)
multiplication_3 = Multiplication(A=subtraction, B=x_offset)
multiplication_4 = Multiplication(A=multiplication_3, B=X)
addition = Addition(A=multiplication_4, B=multiplication_2)
move = Move(Geometry=brep, Motion=addition)  # -> Geometry, Transform
trim = TrimWithBrep(Curve=crv_3, Brep=move.Geometry)  # -> Inside, Outside
trim_2 = TrimTree(Tree=trim.Inside, Depth=1)
crv_4 = Curve(trim_2)

# ----
input_geometry = Curve(crv_4)

# ---- group: One curve becomes several; rearrange tree to make individual top level branches
crv_5 = Curve(crv_4)
sift = SiftPattern(List=crv_5, SiftPattern=[0, 1])  # -> Output0, Output1

# ----
flip = FlipCurve(Curve=sift.Output1)  # -> Curve, Flag
crv_6 = Curve(sift.Output0)
combine = CombineData(Input0=crv_6, Input1=flip.Curve)  # -> Result, Index
clean = CleanTree(RemoveNulls=True, RemoveInvalid=True, RemoveEmpty=True, Tree=combine.Result)
crv_7 = Curve(clean)

# ---- group: Last Curve
lng = ListLength(List=crv_7)
subtraction_2 = Subtraction(A=lng, B=1)
item_2 = ListItem(List=crv_7, Index=subtraction_2, Wrap=False)
end = EndPoints(Curve=item_2)  # -> Start, End

# ----
panel_6 = Panel(subtraction_2)

# ---- group: First Curve
item_3 = ListItem(List=crv_7, Index=0, Wrap=True)
end_2 = EndPoints(Curve=item_3)  # -> Start, End

# ----
panel_7 = Panel(crv_4)

# ---- group: Create Entry Path
pdecon = Deconstruct(Point=end_2.Start)  # -> XComponent, YComponent, ZComponent
pt = ConstructPoint(XCoordinate=pdecon.XComponent, YCoordinate=pdecon.YComponent, ZCoordinate=passing_height)
ln = Line(StartPoint=pt, EndPoint=end_2.Start)

# ---- group: Create Exit Path
pdecon_2 = Deconstruct(Point=end.End)  # -> XComponent, YComponent, ZComponent
pt_2 = ConstructPoint(XCoordinate=pdecon_2.XComponent, YCoordinate=pdecon_2.YComponent, ZCoordinate=passing_height)
ln_2 = Line(StartPoint=end.End, EndPoint=pt_2)

# ---- group: Connect Entry and Exit Paths
ins = InsertItems(List=crv_7, Item=ln, Indices=0, Wrap=False)
lng_2 = ListLength(List=ins)
ins_2 = InsertItems(List=ins, Item=ln_2, Indices=lng_2, Wrap=False)

# ----
crv_8 = Curve(ins_2)

# ---- group: Filename
rhatt = GetRhinoAttributes(Geometry=crv_8, readFullPath=True)  # -> Name, Layer, Color
rep = ReplaceText(Text=rhatt.Layer, Find="::", Replace=" - ", RecursiveReplace=False)
concat = Concatenate(FragmentA=activedoc.Name, FragmentB=" - ")
concat_2 = Concatenate(FragmentA=concat, FragmentB=rep)

# ---- group: Move curves to machine origin
neg = Negative(Value=addition)
move_2 = Move(Geometry=crv_8, Motion=neg)  # -> Geometry, Transform

# ---- group: Create Toopath Points
topoly = CurveToPolyline(Curve=move_2.Geometry, ToleranceDistance=0.0005, ToleranceAngle=0)  # -> Polyline, Segments
explode = Explode(Curve=topoly.Polyline, Recursive=True)  # -> Segments, Vertices
clean_2 = CleanTree(RemoveNulls=True, RemoveInvalid=True, RemoveEmpty=True, Tree=explode.Vertices)

# ----
final_toolpath = Curve(topoly.Polyline)
move_3 = Move(Geometry=final_toolpath, Motion=vec.Vector)  # -> Geometry, Transform
move_4 = Move(Geometry=clean_2, Motion=vec_2.Vector)  # -> Geometry, Transform

# ---- group: Tree Explorer
object = Slider(0, range=0..31)
move_5 = Slider(0, range=0..11)
layer = Slider(0, range=0..31)
crv_9 = Curve(ins_2)
panel_8 = Panel(crv_9)
path_mapper_2 = PathMapper(crv_9, source="{A;B;C}", target="{A;B}")
concat_3 = Concatenate(FragmentA=object, FragmentB=";", FragmentC=layer)
branch = TreeBranch(Tree=path_mapper_2, Path=concat_3, MaintainPaths=True)
panel_9 = Panel(path_mapper_2)
item_4 = ListItem(List=branch, Index=move_5, Wrap=False)

# ---- group: Part File
m3 = CSharpScript(pts=move_4.Geometry, passingHeight=passing_height)  # -> out, flatten(A); inputs pts: list
# ---------- m3: C# ----------
    // Convert each point in incoming point list to ShopBot M3 command
    System.Text.StringBuilder result = new System.Text.StringBuilder();
    double _passingHeight = 0.5;
    if (passingHeight != null)
      double.TryParse(passingHeight as string, out _passingHeight);
    foreach (var p in pts)
    {
      var pt = (Rhino.Geometry.Point3d) p;
      if (pt.Z >= _passingHeight)
        result.Append("J3 ");
      else
        result.Append("M3 ");

      result.Append(pt.X.ToString("N4")).Append(",");
      result.Append(pt.Y.ToString("N4")).Append(",");
      result.Append(pt.Z.ToString("N4"));
      result.Append("\n");
    }
    A = result.ToString();
# ---------- end m3 ----------
feeds = CSharpScript(mxy=tool.FR, mz=division, jxy=5, jz=5)  # -> out, VS
# ---------- feeds: C# ----------
    VS = string.Format("VS {0:N4}, {1:N4}, 1, 1, {2}, {3}, 1, 1", mxy, mz, jxy, jz);
# ---------- end feeds ----------
header = Panel("""SO 1,1  ' Turn on router
Pause 2 ' Wait 2 seconds
SA      ' Absolute mode""")
footer = Panel("""'MZ 0.25
SO 1,0  ' Turn off router""")
sbp_file = Panel([header, feeds.VS, m3.A, footer])
ascii_file = CSharpScript(Content=sbp_file, Directory=activedoc.Folder, Filename=concat_2, Write=save_now)  # -> output, path; inputs Content: list
# ---------- ascii_file: C# ----------
    // Write ASCII file to path
    var result = new System.Text.StringBuilder();

    var dir = (String) Directory;
    var file = Filename as String;

    var existing = System.IO.Directory.GetFiles(dir, file + " *");
    int max_index = 0;
    foreach (var e in existing) {
      result.Append("Reading ").Append(e).Append("\r\n");
      var n = e.Replace(System.IO.Path.Combine(dir, file + " "), "");
      n = n.Replace(".sbp", "");
      result.Append("Converting to int: ").Append(n);
      int e_index;
      if (int.TryParse(n, out e_index))
      {
        max_index = Math.Max(max_index, e_index);
        result.Append(" ... success! ").Append(max_index.ToString()).Append("\r\n");
      }
      else {
        result.Append(" ... failed\n").Append("\r\n");
      }
    }

    var this_index = max_index + 1;
    var last_written = file + " " + max_index.ToString("D4") + ".sbp";

    file += " " + this_index.ToString("D4") + ".sbp";


    result.Append("Saving to: ").Append(file);

    var fullpath = System.IO.Path.Combine(dir, file);
    path = last_written;

    bool write = (bool) Write;
    if (write) {
      var sb = new System.Text.StringBuilder();
      foreach (object s in Content) {
        sb.Append((string) s).Append("\r\n");
      }

      System.IO.File.WriteAllText(fullpath, sb.ToString());
    }

    output = result.ToString();
# ---------- end ascii_file ----------

# ----
project_name = Panel(ascii_file.output)
fabmopost = CSharpScript(
    CutNow=cut,
    Pause=pause,
    Resume=resume,
    Quit=quit,
    IP="192.168.42.1",
    SBPFile=sbp_file,
    Reference="C:\Windows\assembly\NativeImages_v4.0.30319_64\System.Net.Http\d9673165e138070d27961581a90e5e1b\System.Net.Http.ni.dll")  # -> out, status, sent_file; inputs CutNow: Boolean, Pause: Boolean, Resume: Boolean, Quit: Boolean, IP: String, SBPFile: tree of String
# ---------- fabmopost: C# ----------
    try {
      var client = new System.Net.Http.HttpClient();

      // Clean up duplicate points in SBP file
      var clean_file = new System.Text.StringBuilder();
      foreach (var branch in SBPFile.Branches)
      {
        foreach (var element in branch) {
          var lines = System.Text.RegularExpressions.Regex.Split(element, "\r\n|\r|\n");
          foreach (var line in lines)
          {
            if (line == _last_line)
            {
              //clean_file.Append("' Removed ").Append(line).Append("\r\n");
              continue;
            }
            else if (string.IsNullOrWhiteSpace(line))
            {
              //clean_file.Append("' Skipping blank line").Append("\r\n");
              continue;
            }
            else {
              clean_file.Append(line);
              //clean_file.Append("  ' >>> ").Append(_last_line);
              clean_file.Append("\r\n");
              //clean_file.Append("--\r\n");
              //clean_file.Append("' Setting last_line to: >").Append(line).Append("<\r\n");
              _last_line = line;
            }
          }
          clean_file.Append("\r\n");
        }
        clean_file.Append("\r\n\r\n");
      }
      var pairs = new List<KeyValuePair<string, string>>
        {
          new KeyValuePair<string, string>("runtime", "sbp"),
          new KeyValuePair<string, string>("cmd", clean_file.ToString())
          };

      if (CutNow)
      {
        var content = new System.Text.StringBuilder();
        foreach (var pair in pairs)
        {
          MessageBox.Show(pair.Value);
          //content.Append(System.Net.WebUtility.UrlEncode(pair.Key));
          //content.Append("=");
          //content.Append(System.Net.WebUtility.UrlEncode(pair.Value));
          //content.Append("&");
        }

        var url = string.Format("http://{0}/code", IP);
        //MessageBox.Show(content.ToString());
        return;
        // var response = client.PostAsync(url, new StringContent(content.ToString())).Result;
        //_status = string.Format("Cutting ({0})", response.StatusCode);
      }
      else if (Pause)
      {
        var url = string.Format("http://{0}/pause", IP);
        var response = client.PostAsync(url, null).Result;
        _status = string.Format("Pausing ({0})", response.StatusCode);
      }
      else if (Quit)
      {
        var url = string.Format("http://{0}/quit", IP);
        var response = client.PostAsync(url, null).Result;
        _status = string.Format("Quitting ({0})", response.StatusCode);
      }
      else if (Resume)
      {
        var url = string.Format("http://{0}/resume", IP);
        var response = client.PostAsync(url, null).Result;
        _status = string.Format("Resume Cutting ({0})", response.StatusCode);
      }

      status = _status;
      sent_file = clean_file.ToString();
    }
    catch (Exception ex)
    {
      throw(ex);
      //status = ex.ToString();
    }
# ---------- fabmopost: C# additional code ----------
  string _status = "Idle";
  string _last_line = "";
# ---------- end fabmopost ----------
panel_10 = Panel(fabmopost.status)
